# Grasshopper definition GRASSHOPPER LAYOUT.gh (Grasshopper 1.0.8)
# plug-ins: Heteroptera, Pufferfish, Portal, Bifocals

# ----
# FURNITURE (boxes)
interior_partition = Geometry(<curve referenced from the Rhino model>)
doublebed = Geometry([<curve referenced from the Rhino model> x6])
window01 = Geometry([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])
dblsinnk = Geometry([<curve referenced from the Rhino model> x90])
loveseat = Geometry([<curve referenced from the Rhino model> x78])
couch01 = Geometry([<curve referenced from the Rhino model> x43])
doorlh = Geometry([<curve referenced from the Rhino model> x5, <hatch referenced from the Rhino model>, <curve referenced from the Rhino model>, <hatch referenced from the Rhino model>])
doorrh = Geometry([<curve referenced from the Rhino model> x5, <hatch referenced from the Rhino model> x2, <curve referenced from the Rhino model>])
chair01 = Geometry([<curve referenced from the Rhino model> x10])
desk = Geometry([<curve referenced from the Rhino model> x15])
lav = Geometry([<curve referenced from the Rhino model> x199])
shower = Geometry([<curve referenced from the Rhino model> x1900])
wc = Geometry([<curve referenced from the Rhino model> x46])
counter = Geometry([<curve referenced from the Rhino model> x6])
stove = Geometry([<curve referenced from the Rhino model> x81])
exterior_wall = Geometry([<hatch referenced from the Rhino model> x3, <curve referenced from the Rhino model> x7])
center = Center(Geometry=exterior_wall, forall=True, referenceAll=1)  # -> Center, Dimension
center_2 = Center(Geometry=wc, forall=True, referenceAll=1)  # -> Center, Dimension
center_3 = Center(Geometry=loveseat, forall=True, referenceAll=1)  # -> Center, Dimension
center_4 = Center(Geometry=doorlh, forall=True, referenceAll=1)  # -> Center, Dimension
center_5 = Center(Geometry=shower, forall=True, referenceAll=1)  # -> Center, Dimension
center_6 = Center(Geometry=couch01, forall=True, referenceAll=1)  # -> Center, Dimension
center_7 = Center(Geometry=stove, forall=True, referenceAll=1)  # -> Center, Dimension
center_8 = Center(Geometry=window01, forall=True, referenceAll=1)  # -> Center, Dimension
center_9 = Center(Geometry=doorrh, forall=True, referenceAll=1)  # -> Center, Dimension
center_10 = Center(Geometry=chair01, forall=True, referenceAll=1)  # -> Center, Dimension
center_11 = Center(Geometry=desk, forall=True, referenceAll=1)  # -> Center, Dimension
center_12 = Center(Geometry=lav, forall=True, referenceAll=1)  # -> Center, Dimension
center_13 = Center(Geometry=counter, forall=True, referenceAll=1)  # -> Center, Dimension
center_14 = Center(Geometry=doublebed, forall=True, referenceAll=1)  # -> Center, Dimension
center_15 = Center(Geometry=interior_partition, forall=True, referenceAll=1)  # -> Center, Dimension
center_16 = Center(Geometry=dblsinnk, forall=True, referenceAll=1)  # -> Center, Dimension
entwine = Entwine(
    Branch00=couch01,
    Branch01=window01,
    Branch02=doorlh,
    Branch03=chair01,
    Branch04=desk,
    Branch05=dblsinnk,
    Branch06=interior_partition,
    Branch07=lav,
    Branch08=counter,
    Branch09=doublebed,
    Branch010=stove,
    Branch011=shower,
    Branch012=wc,
    FlattenInputs=True)  # -> simplify(Result)
center_17 = Center(Geometry=entwine, forall=True, referenceAll=0)  # -> Center, Dimension
point = Point(center_17.Center)
panel = Panel(center_17.Dimension)

# ----
# IMPORT DATA
# FROM PYTHON
toggle = BooleanToggle(True)
udp = UdpReceiver(Port="5000", Start=toggle)
py3 = Python3Script(data=udp)  # -> a
# ---------- py3: Python ----------
data_bytes = bytearray(data)
a = data_bytes.decode("utf-8")
# ---------- end py3 ----------
panel_2 = Panel(py3)
py3_2 = Python3Script(geo_data=py3)  # -> a, x, y, rotation; inputs geo_data: String
# ---------- py3_2: Python ----------
import rhinoscriptsyntax as rs
import math
import ast
import Rhino.Geometry as rg

# Initialize outputs
points = []
x = []
y = []
rotation = []

try:
    if isinstance(geo_data, str) and geo_data:
        print(f"Received geo_data: {geo_data}")  # Debug raw input
        if geo_data == "RESET":
            print("Received RESET command")
            points = []
            x = []
            y = []
            rotation = []
        elif geo_data.startswith("EVENT:"):
            print(f"Received event: {geo_data}")
        else:
            # Parse JSON string into dictionary
            geo_data = ast.literal_eval(geo_data)
            if isinstance(geo_data, dict) and 'POS' in geo_data and 'ANGLE' in geo_data:
                # Create Point3d objects and x, y lists for positions
                for pos in geo_data['POS']:
                    if isinstance(pos, (list, tuple)) and len(pos) == 2:
                        points.append(rg.Point3d(float(pos[0]), float(pos[1]), 0))
                        x.append(float(pos[0]))  # Add x coordinate
                        y.append(float(pos[1]))  # Add y coordinate
                    else:
                        print(f"Invalid POS entry: {pos}")
                # Copy angles, ensure they are floats
                rotation = [float(angle) for angle in geo_data['ANGLE']]
                print(f"Parsed points: {points}")  # Debug output
                print(f"Parsed x: {x}")  # Debug output
                print(f"Parsed y: {y}")  # Debug output
                print(f"Parsed rotation: {rotation}")  # Debug output
            else:
                print("Error: geo_data is not a valid dictionary with POS and ANGLE keys")
    else:
        print("Error: geo_data is empty or not a string")
except Exception as e:
    print(f"Error parsing geo_data: {str(e)}")
    print(f"Raw geo_data: {geo_data}")  # Debug raw input on error

# Outputs for Grasshopper
a = points  # List of Point3d for box positions
b = rotation  # List of angles in degrees
c = x  # List of x coordinates
d = y  # List of y coordinates
# ---------- end py3_2 ----------
panel_3 = Panel(py3_2.rotation)
panel_4 = Panel(py3_2.x)
panel_5 = Panel(py3_2.a)

# ----
# working area
point_2 = Point(<point referenced from the Rhino model>)
point_3 = Point(<point referenced from the Rhino model>)
rectangle_2pt = Rectangle2Pt(Plane=PlaneXY(0, 0, 0), PointA=point_3, PointB=point_2, Radius=0)  # -> Rectangle, Length
curve = Curve(rectangle_2pt.Rectangle)
boundary_surfaces = BoundarySurfaces(Edges=curve)

remap_numbers = RemapNumbers(Value=py3_2.x, Source="0 to 640", Target=Domain(0, 1))  # -> Mapped, Clipped
remap_numbers_2 = RemapNumbers(Value=py3_2.y, Source="0 to 480", Target=Domain(0, 1))  # -> Mapped, Clipped
construct_point = ConstructPoint(XCoordinate=remap_numbers.Mapped, YCoordinate=remap_numbers_2.Mapped, ZCoordinate=0)

# ----
# EXPORTED LAYOUT
evaluate_surface = EvaluateSurface(Surface=reparameterize(boundary_surfaces), Point=graft(construct_point))  # -> Point, Normal, UDirection, VDirection, Frame
move_to_point = MoveToPoint(Geometry=entwine, PointA=point, PointB=simplify(evaluate_surface.Point))  # -> Moved, Vector, Transform
center_18 = Center(Geometry=move_to_point.Moved, forall=True, referenceAll=1)  # -> Center, Dimension
rotate = Rotate(Geometry=move_to_point.Moved, Angle=simplify(graft(degrees(py3_2.rotation))), Plane=center_18.Center)  # -> Geometry, Transform
